# Grasshopper definition CAD-to-sdTF.ghx (Grasshopper 1.0.8)
# plug-ins: ShapeDiverForGrasshopper

sddp = ShapeDiverDocumentPayload({AbsoluteTolerance=0, AngleTolerance=0, DistanceDisplayPrecision=0, GltfVersion="Gltf2", GrasshopperVersion="1.0.0008", InputGroups="{}", OutputGroups="{}", RelativeTolerance=0, RhinoVersion="8.11.24254.15001", UnitSystem=0, VersionCreated="1.20.0.0", VersionSaved="1.20.0.0"})
cadfileurl = DirectTextInput(maxlength=10000)
cadfile = ImportGeometry(
    URI=cadfileurl,
    maximum_file_size=52428800,
    selected_file_formats="application/3dm,application/3ds,application/ai,application/amf,application/dgn,application/dwg,application/dxf,application/fbx,application/off,application/pdf,application/ply,application/postscript,application/skp,application/sla,application/slc,application/step,application/vda,application/wavefront-obj,image/svg+xml,model/3mf,model/iges,model/stl")  # -> Object, Material, Filename
# The output component
# does not support generic
# geometry. Separate into
# mesh, curve, brep, etc.
mesh = Mesh(cadfile.Object)
crv = Curve()
brep = Brep()
sdoutput = ShapeDiverOutput(
    Out0=mesh,
    Out1=crv,
    Out2=brep,
    ParameterSchemas="""={
  "96a9d829-3532-47ac-bafc-3b1bea19f056": {
    "UniversalProperties": {
      "Structure": "item",
      "Guid": "b178a65e-a0a1-476c-a8cc-f3d7e646733d",
      "ParamUiIndex": 289,
      "ParamGroupGuid": "dda37811-ce26-4e94-bdf0-815793c7e75e",
      "Name": "Mesh",
      "Description": "",
      "TypeCode": 211
    },
    "ImplementationType": "unknown",
    "ImplementationProperties": {}
  },
  "0c0c8703-1b66-4768-a429-ae0f306419fd": {
    "UniversalProperties": {
      "Structure": "item",
      "Guid": "bb86c32b-e3a4-4172-8731-e4569b6b6408",
      "ParamUiIndex": 313,
      "ParamGroupGuid": "dda37811-ce26-4e94-bdf0-815793c7e75e",
      "Name": "Crv",
      "Description": "",
      "TypeCode": 204
    },
    "ImplementationType": "unknown",
    "ImplementationProperties": {}
  },
  "d9066a3d-9ecb-4ddb-8fa3-dbdb6b96a772": {
    "UniversalProperties": {
      "Structure": "item",
      "Guid": "67570499-9e3a-4961-96a2-261c0a72b931",
      "ParamUiIndex": 337,
      "ParamGroupGuid": "dda37811-ce26-4e94-bdf0-815793c7e75e",
      "Name": "Brep",
      "Description": "",
      "TypeCode": 210
    },
    "ImplementationType": "unknown",
    "ImplementationProperties": {}
  }
}""")
